vi "Main.gviweb"   [LabVIEW NXG 2.0.0]
panel controls:
  "Tab": i32
  "Skyline.Examples.DataServices.int_control": bool
  "Skyline.Examples.DataServices.numeric_slider-control": f64
  "Skyline.Examples.DataServices.string_control": string
  "Hyperlink Control": string
  "password": string
  "username": string
  "connect": bool
  "server url": string
  "Skyline.Examples.Oven.Inside.Temp-slider-control": f64
  "Skyline.Examples.Oven.Outside.Temp-slider-control": f64
panel indicators:
  "Skyline.Examples.DataServices.int_indicator": bool
  "Skyline.Examples.DataServices.numeric_gauge-indicator": f64
  "Skyline.Examples.DataServices.string_indicator": string
  "error state": string
  "Skyline.Examples.Oven.Inside.Temp-tank-indicator": f64
  "Skyline.Examples.Oven.Outside.Temp-tank-indicator": f64
uses:
  NI::G Core::Error::Clear Error Cluster.gvi
  subvis::Initialize.gvi
  subvis::Read Example Tags.gvi
  subvis::Write Example Tags.gvi
  subvis::Handle Error and Reconnect.gvi
diagram:
  s1 = uninitialised  # shift register
  s2 = uninitialised  # shift register
  s3 = "initialize"  # shift register
  while {
    Wait(time to wait=250)
    case (s3) {
      frame "initialize", Default {
        call "Clear Error Cluster.gvi"(error in=s1) -> (error out=w4)
        sequence (after w4) {
          frame 0 {
            $"error state" <- ""
          }
        }
        # Writing to tags in first iteration to work around
        # http://nippm.natinst.com/itg/web/knta/crt/RequestDetail.jsp?REQUEST_ID=663403
        call "Initialize.gvi"(server url=$"server url", username=$username, password=$password, error in=w4) -> (error out=w2, tags=w3)
        w1 = "write-tags"
      }
      frame "read-tags" {
        call "Read Example Tags.gvi"(tags in=s2, error in=s1) -> (tags out=w3, example.skyline-data-services.int_indicator=w5, example.skyline-data-services.numeric_gauge-indicator=w6, example.skyline-data-services.string_indicator=w7, Skyline.Examples.Oven.Inside.Temp-tank-indicator=w8, Skyline.Examples.Oven.Outside.Temp-tank-indicator=w9, error out=w2)
        $"Skyline.Examples.Oven.Outside.Temp-tank-indicator" <- w9
        $"Skyline.Examples.DataServices.int_indicator" <- w5
        $"Skyline.Examples.DataServices.numeric_gauge-indicator" <- w6
        $"Skyline.Examples.DataServices.string_indicator" <- w7
        $"Skyline.Examples.Oven.Inside.Temp-tank-indicator" <- w8
        w1 = $Tab
      }
      frame "write-tags" {
        call "Write Example Tags.gvi"(tags in=s2, example.skyline-data-services.int_control=$"Skyline.Examples.DataServices.int_control", example.skyline-data-services.numeric_slider-control=$"Skyline.Examples.DataServices.numeric_slider-control", example.skyline-data-services.string_control=$"Skyline.Examples.DataServices.string_control", Skyline.Examples.Oven.Inside.Temp-slider-control=$"Skyline.Examples.Oven.Inside.Temp-slider-control", Skyline.Examples.Oven.Outside.Temp-slider-control=$"Skyline.Examples.Oven.Outside.Temp-slider-control", error in=s1) -> (tags out=w3, errror out=w2)
        w1 = $Tab
      }
      frame "error-no-skyline" {
        Property Node(instance in=s1) -> ("code"=w10, "source"=w11)
        case (w10) {
          frame 0 {
            w12 = ""
          }
          frame 1, Default {
            w12 = w11
          }
          frame 363650 {
            w13 = """An error has occured for the possible following reasons:

1) Server URL is incorrect. Please ensure you include the protocol (http:// or https://) and port number 

2) Username or password are not included. You either need to enter your username and password into the example or host this Web application in the NI Web server and log into the Skyline WebUI. View the readme for this example for more details."""
            w12 = w13
          }
          frame -251250 {
            w14 = """An error has occured for the possible following reasons:

1) User name or password are incorrect

2) No server URL has been provided

3) There is a mistake in the protocol portion (http:// or https://) of the server URL"""
            w12 = w14
          }
        }
        $"error state" <- w12
        w1 = s3
        w2 = s1
        w3 = s2
      }
    }
    call "Handle Error and Reconnect.gvi"(state in=w1, connect=$connect, Error_2=w2) -> (state out=w15, Error_3=w16)
    next s1 = w16
    next s2 = w3
    next s3 = w15
    stop if FALSE
  }
